# Grasshopper definition assembly_design.ghx (Grasshopper 1.0.8)
# plug-ins: RhinoCodePluginGH

front_wall = Geometry(<extrusion referenced from the Rhino model>)
right_wall = Geometry(<extrusion referenced from the Rhino model>)
left_wall = Geometry(<extrusion referenced from the Rhino model>)
back_wall = Geometry(<extrusion referenced from the Rhino model>)
top = Geometry(<surface referenced from the Rhino model>)
bottom = Geometry(<surface referenced from the Rhino model>)
mesh = Mesh(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)  # disabled
building_components = Python3Script(front=front_wall, right=right_wall, left=left_wall, back=back_wall, top=top, bottom=bottom)  # -> out, cell_network; inputs front: Mesh, right: Mesh, left: Mesh, back: Mesh, top: Mesh, bottom: Mesh
# ---------- building_components: Python ----------
from climate_active_envelopes.assembly import CAEComponent as component
from compas_rhino.conversions import mesh_to_compas
from compas.datastructures import CellNetwork
from compas.datastructures import Mesh, mesh


front_face = component.from_shape(mesh_to_compas(front))
right_face = component.from_shape(mesh_to_compas(right))
left_face = component.from_shape(mesh_to_compas(left))
back_face = component.from_shape(mesh_to_compas(back))
top_face = component.from_shape(mesh_to_compas(top))
bottom_face = component.from_shape(mesh_to_compas(bottom))

cell_network = CellNetwork()

face_objects = [front_face, right_face, left_face, back_face, top_face, bottom_face]

for face in face_objects:
    vertices = [cell_network.add_vertex(x=x, y=y, z=z) for x, y, z in face.vertices]
    faces = [cell_network.add_face(fverts) for fverts in face.faces]

cell_network.add_cell(faces)


print(cell_network)
# ---------- end building_components ----------
pln = Plane(PlaneXY(0, 0, 0))  # disabled

# ---- group: front_element
number_slider = Slider(3, range=0.4..10)  # disabled
number_slider_2 = Slider(3, range=0.3..10)  # disabled
panel = Panel("stretcher_header_bond")  # disabled
reference_element = GhPythonScript(plane=pln, rh_mesh=mesh, length=number_slider, height=number_slider_2, bond_type=panel)  # -> front_element, M; disabled
# ---------- reference_element: Python ----------
from climate_active_envelopes.assembly import ReferenceElement as Element
from compas.artists import Artist
from compas.geometry import Frame
from compas_rhino.geometry import RhinoMesh


frame = Frame(plane.Origin, plane.XAxis, plane.YAxis)

rhino_mesh = RhinoMesh.from_geometry(rh_mesh)
compas_mesh = rhino_mesh.to_compas()

front_element = Element.from_parameters(frame, compas_mesh, length, height, bond_type)

print front_element.length


M = Artist(front_element.mesh).draw()
# ---------- end reference_element ----------

# ----
py3 = Python3Script(cell_network=building_components.cell_network)  # -> out, a; inputs connectivity: list, cell_network: list
# ---------- py3: Python ----------
from climate_active_envelopes.assembly import CAEComponent as component
from climate_active_envelopes.assembly import CAEReferenceModel as ReferenceModel
from compas.datastructures import Network, CellNetwork


#cell_network = CellNetwork()

print(cell_network)

for network in cell_network:
    print(list(network.cells()))


#print(cell_network.cell_face_neighbors(cell, face))


# print(reference_model.edges())



# data = reference_model.network.to_data()
# network = Network.from_data(data)



# nodes, edges = NetworkArtist(network).draw()
# ---------- end py3 ----------
mesh_2 = Mesh(reference_element.M)  # disabled
connectivity = GhPythonScript()  # -> connectivity
# ---------- connectivity: Python ----------
connectivity = [[0,1], [1,2], [2,3], [3,0]]

#print reference_model.add_connection(0, 2)
#reference_model.add_connection(1, 3)
#reference_model.add_connection(2, 1)
#reference_model.add_connection(3, 0)
# ---------- end connectivity ----------

# ----
# Generate brick parts
list = ValueList({"none", "full", "insulated"}, selected="full")
part = Python3Script()  # -> out, full_brick, insulated_brick
# ---------- part: Python ----------
import os
from compas.geometry import Frame, Box
from compas.datastructures import Mesh
from climate_active_envelopes.assembly import CAEPart as Part



#full_brick
length, width, height = 0.24, 0.115, 0.075
full_brick = Part.from_dimensions(length=length, width=width, height=height)
full_brick.attributes['name'] = "full_brick"
#print(full_brick.attributes)
print(full_brick.__data__)

#insulated_brick_placeholder
length, width, height = 0.245, 0.12, 0.075
insulated_brick = Part.from_dimensions(length=length, width=width, height=height)
insulated_brick.attributes['name'] = "insulated_brick"
#print(insulated_brick.__data__)



#insulated_brick
# package_path = ghdoc.Path
# data_path = os.path.abspath(os.path.join(package_path,"../../../climate_active_envelopes/data/brick_types"))
# filename = 'insulated_brick_reduced.stl'
# insulated_brick_mesh = Mesh.from_stl(os.path.join(data_path, filename))
# insulated_brick = Part.from_mesh_and_frame(insulated_brick_mesh)
# insulated_brick.attributes['name'] = "insulated_brick"
# #print(insulated_brick.__data__)
# ---------- end part ----------
draw = Python3Script(full_brick=part.full_brick, insulated_brick=part.insulated_brick, show=list)  # -> M, P
# ---------- draw: Python ----------
from compas_rhino.conversions import mesh_to_rhino, box_to_rhino, frame_to_rhino
from climate_active_envelopes.assembly import CAEPart as Part
from compas.geometry import Frame
from compas.geometry import Vector
from compas.geometry import Box


if show=="full":

    #extract the mesh of the part for visulization
    compas_mesh_full = full_brick.mesh

    #convert to rhino mesh
    M = mesh_to_rhino(compas_mesh_full)

    #extract and convert to rhino plane
    P = frame_to_rhino(full_brick.frame)
    #brick_full.gripping_frame = full_brick.frame
    #print(full_brick.__data__)
    print(type(full_brick))

    
elif show == "insulated":
    
    #extract the mesh of the part for visulization
    compas_mesh_insulated = insulated_brick.mesh

    #convert to rhino mesh
    M = mesh_to_rhino(compas_mesh_insulated)
    
    #extract and convert to rhino plane
    P = frame_to_rhino(insulated_brick.frame)

else:
    pass
# ---------- end draw ----------
mesh_3 = Mesh(draw.M)
pln_2 = Plane(draw.P)

compas = Python3Script()  # -> out
# ---------- compas: Python ----------
import compas
print(compas.__version__)
# ---------- end compas ----------
list_2 = ValueList({"rotate", "translate"}, selected="rotate")

# ----
# Unload Python modules
button = Button()
unload = Python3Script(unload=button)  # -> out, a
# ---------- unload: Python ----------
from compas_ghpython import unload_modules

unload_modules('climate_active_envelopes')
unload_modules('assembly_information_model')
# ---------- end unload ----------

reference_model = GhPythonScript(init=Button(), reference_elements=reference_element.front_element, connectivity=connectivity)  # -> out, reference_model; inputs reference_elements: list, connectivity: list
# ---------- reference_model: Python ----------
from climate_active_envelopes.assembly import ReferenceModel
from compas.datastructures import Network
from compas_ghpython.artists import NetworkArtist



reference_model = ReferenceModel()

for i, element in enumerate(reference_elements):
    reference_model.add_element(element)

print connectivity

for connection in connectivity:
    reference_model.add_connection(connection[0], connection[1])

data = reference_model.network.to_data()
network = Network.from_data(data)



nodes, edges = NetworkArtist(network).draw()
# ---------- end reference_model ----------
mesh_4 = Mesh(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)
pln_3 = Plane(PlaneXY(0, 0, 0))
total_length = Panel(compas)
geometry_input = Brep(<brep referenced from the Rhino model>)

# ----
# Slicing mesh input
layer_height = Slider(0.1, range=0..1)
contour = Python3Script(brep=geometry_input, layer_height=layer_height)  # -> out, curves; inputs brep: Mesh, layer_height: Double
# ---------- contour: Python ----------
import Rhino.Geometry as rg

mesh = brep

vertices = mesh.Vertices
pt_base = vertices[0]
pt_end = vertices[2]
print(pt_end)

pt_base = vertices[0]
pt_end = vertices[1]


start_plane = rg.Plane(pt_base, rg.Vector3d(0, 0, 1))
end_plane = rg.Plane(pt_end, rg.Vector3d(0, 0, 1))

curves =rg.Mesh.CreateContourCurves(mesh, pt_base,  pt_end, layer_height)
# ---------- end contour ----------
crv = Curve(contour.curves)

# ----
# Shading Simulation
toggle = BooleanToggle(True)
number_slider_3 = Slider(0, range=0..360)
epw_file = FilePath("C:\Users\julia\Downloads\DEU_BY_Munich-Theresienwiese.108650_TMYx\DEU_BY_Munich-Theresienwiese.108650_TMYx.epw")
context_input = Brep([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])
number_slider_4 = Slider(0.2, range=0..1)
shading_simulation = ShadingSimulation(
    start_month=Slider(7, range=0..10),
    start_day=Slider(1, range=0..10),
    start_hour=Slider(11, range=0..100),
    end_month=Slider(8, range=0..10),
    end_day=Slider(31, range=0..100),
    end_hour=Slider(16, range=0..100),
    north=number_slider_3,
    geometry=geometry_input,
    epw_file=epw_file,
    context=context_input,
    grid_size=Slider(0.04, range=0..0.1),
    offset_dist=number_slider_4,
    run=toggle)  # -> hoys, location, sky_mtx, results, mesh, legend

# ----
# Create empty assembly datastructure
button_2 = Button()
assembly = Python3Script(init=button_2)  # -> out, my_assembly
# ---------- assembly: Python ----------
from climate_active_envelopes.assembly import CAEAssembly as Assembly

#create empty assembly
my_assembly = Assembly()
# ---------- end assembly ----------

py3_2 = Python3Script(mesh=mesh_4, plane=pln_3, length=Slider(3, range=0.4..10), height=Slider(3, range=0.4..10), bond_type="flemish_bond")  # -> out, a; inputs mesh: Mesh
# ---------- py3_2: Python ----------
from climate_active_envelopes import CAEElement



# from climate_active_envelopes.element import CAEElement as Element
# #from climate_active_envelopes.assembly import ReferenceElement as Element
# from compas.geometry import Frame
# #from compas_rhino.geometry import RhinoMesh



# frame = Frame(plane.Origin, plane.XAxis, plane.YAxis)

# #rhino_mesh = RhinoMesh.from_geometry(rh_mesh)
# #compas_mesh = rhino_mesh.to_compas()

# front_element = Element.from_parameters(frame, compas_mesh, length, height, bond_type)

# print(front_element.length)
# ---------- end py3_2 ----------
geo = Geometry(shading_simulation.legend)

visualize = Python3Script(show=Toggle(False), mesh=shading_simulation.mesh)  # -> out, M
# ---------- visualize: Python ----------
if show == True:
    M = mesh
# ---------- end visualize ----------
mesh_5 = Mesh(visualize.M)

panel_2 = Panel(geo)
list_3 = ValueList({"Single layer": "single_layer", "Double layer": "double_layer"}, selected="Double layer")

# ----
# Create brick assembly
list_4 = ValueList({"Flemish bond": "flemish_bond"}, selected="Flemish bond")
create_assembly = Python3Script(
    bond_type=list_4,
    wall_system=list_3,
    my_assembly=assembly.my_assembly,
    brick_full=part.full_brick,
    brick_insulated=part.insulated_brick,
    plane=pln_2,
    lines=contour.curves)  # -> out, my_assembly, total_length; inputs plane: Plane, lines: list of Line
# ---------- create_assembly: Python ----------
total_length = my_assembly.generate_wall(bond_type,
                        wall_system, 
                        brick_full, 
                        brick_insulated,
                        plane,
                        lines
                        )
# ---------- end create_assembly ----------
total_length_2 = Panel(create_assembly.total_length)

get_centroids = Python3Script(my_assembly=create_assembly.my_assembly, transform_type=list_2)  # -> out, my_assembly, keys; inputs transform_type: String
# ---------- get_centroids: Python ----------
from compas.geometry import Frame, Translation, Rotation, Transformation, Point
from compas_rhino.conversions import plane_to_compas_frame, point_to_compas

import math
import Rhino.Geometry as rg

values = []
keys = []


for key in my_assembly.graph.nodes_where({"transform_type": transform_type}):
    part = my_assembly.part(key)
    keys.append(key)

my_assembly = my_assembly
# ---------- end get_centroids ----------

# ----
# Apply Gradient
vals = Python3Script(results=shading_simulation.results)  # -> out, color_values; inputs results: list
# ---------- vals: Python ----------
from compas.itertools import normalize_values



def normalize_to_highest(values, max_value=140.0, target_min=0.0, target_max=1.0):
    """Normalizes a list of values based on the highest value in the list, 
    scaled to a specific range.

    Args:
    values: A list of numerical values.
    max_value: The expected maximum value. Defaults to 116.0.
    target_min: The minimum value of the target range. Defaults to 0.0.
    target_max: The maximum value of the target range. Defaults to 0.7.

    Returns:
    A list of normalized values.
    """
    highest_value = max(values)
    factor = highest_value / max_value  # Calculate the scaling factor
    normalized_values = normalize_values(values, target_min, target_max * factor)
    return normalized_values


color_values = normalize_to_highest(results)

#color_values = normalize_values(results, 0.0, 0.7)
print(color_values)




"""
color_points = []

for i, point in enumerate(points):
    frame = Frame([color_values[i], point[1] , point[2]], [1,0,0], [0,1,0])
    
    color_points.append(frame.point)
"""
# ---------- end vals ----------
panel_3 = Panel(vals.color_values)
apply_gradient = Python3Script(
    my_assembly=get_centroids.my_assembly,
    values=vals.color_values,
    keys=get_centroids.keys,
    transform_type=list_2,
    transform=Button())  # -> out, my_assembly; inputs values: list, keys: list
# ---------- apply_gradient: Python ----------
import math
import Rhino.Geometry as rg
from compas.geometry import Frame, Point
from compas.geometry import Transformation, Rotation, Translation


#print(my_assembly.apply_gradient(values, keys, transform_type_))


#print(my_assembly.__data__)

#transform_types = {node_id: my_assembly.graph.node_attribute(node_id, 'transform_type') for node_id in my_assembly.graph.nodes()}


if transform:
    assembly = my_assembly
    my_assembly.apply_gradient(values, keys, transform_type)

    #print(test)
# ---------- end apply_gradient ----------

# ----
# Sun Path
number_slider_5 = Slider(0.3, range=0..10)
pt = Point(Point(-0.1120708673, 31.05692892, 0))
sunpath = LBSunPath(
    north=number_slider_3,
    location=shading_simulation.location,
    hoys=shading_simulation.hoys,
    center_pt=pt,
    scale=number_slider_5)  # -> report, vectors, altitudes, azimuths, hoys, sun_pts, analemma, daily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; plug-in component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
geo_2 = Geometry([sunpath.compass, sunpath.daily, sunpath.analemma, sunpath.legend, sunpath.title, sunpath.sun_pts])

# ----
# Transform
toggle_2 = BooleanToggle(False)
pln_4 = Plane(PlaneXY(2.43007085, -1.968439302, -0.2055923429))
transform = Python3Script(my_assembly=apply_gradient.my_assembly, transform=toggle_2, origin_plane=pln_2, new_origin_plane=pln_4)  # -> out, my_assembly
# ---------- transform: Python ----------
from compas.geometry import Frame, Transformation, Rotation, Translation
from compas_rhino.conversions import plane_to_compas_frame


new_origin_frame = plane_to_compas_frame(new_origin_plane)
origin_frame = plane_to_compas_frame(origin_plane)

if transform:
    T = Transformation.from_frame_to_frame(origin_frame, new_origin_frame)
    my_assembly = my_assembly.transformed(T)
# ---------- end transform ----------

start = Button()
stop = Button()
step = Button()
back = Button()
reset = Button()
full = Button()
list_5 = ValueList({"20", "50", "100", "500", "1000", "5000"}, selected="500")
counter = Python3Script(
    my_assembly=transform.my_assembly,
    start=start,
    stop=stop,
    step=step,
    step_back=back,
    reset=reset,
    full=full,
    interval=list_5)  # -> out, counter
# ---------- counter: Python ----------
from scriptcontext import sticky as st
import Grasshopper

def update_component(ghenv, delay):
    """Schedule an update of the Grasshopper component.

    After the specified delay, the GH component will be automatically updated.

    Parameters
    ----------
    ghenv : :class:`GhPython.Component.PythonEnvironment`
        The current GHPython environment.
    delay : :obj:`int`
        Time in milliseconds until the update is performed.

    Raises
    ------
    ValueError
        If the delay is less than zero.

    """
    if delay <= 0:
        raise ValueError("Delay must be greater than zero")

    ghcomp = ghenv.Component
    ghdoc = ghcomp.OnPingDocument()

    def callback(ghdoc):
        if ghdoc.SolutionState != Grasshopper.Kernel.GH_ProcessStep.Process:
            ghcomp.ExpireSolution(False)

    ghdoc.ScheduleSolution(delay, Grasshopper.Kernel.GH_Document.GH_ScheduleDelegate(callback))

L = range(my_assembly.graph.number_of_nodes())

# store data in component
guid = str(ghenv.Component.InstanceGuid)
counter_key = "counter_" + guid
running_key = "running_" + guid

if counter_key not in st:
    st[counter_key] = 0

if running_key not in st:
    st[running_key] = False
    

if st[running_key]:
    if st[counter_key] < len(L) - 1:
        st[counter_key] += 1
        update_component(ghenv, interval)
    else:
        st[counter_key] = 0
        st[running_key] = False
    
if start:
    st[running_key] = True

if stop:
    st[running_key] = False

if step:
    if st[counter_key] < len(L) - 1:
        st[counter_key] += 1

if step_back:
    if st[counter_key] < len(L) - 1:
        st[counter_key] -= 1

if reset:
    st[counter_key] = 0
    st[running_key] = False

if full:
    st[counter_key] = len(L)-1

if len(L):
    item = L[st[counter_key]]


#st["visualisation_counter"] = st[counter_key]
counter = st[counter_key]+1
# ---------- end counter ----------
panel_4 = Panel(counter.counter)

# ----
# Visualisation Dashboard
list_6 = ValueList({"show all": "show_all", "show until key": "show_until_key", "show nothing": "show_nothing"}, selected="show all")
visualize_2 = Python3Script(my_assembly=transform.my_assembly, show=list_6, highlight_current_part=Toggle(False), counter=panel_4)  # -> out, parts_geometry, parts_frame, current_part_geometry, current_part_frame, current_part_gripping_frame
# ---------- visualize_2: Python ----------
from compas_rhino.conversions import mesh_to_rhino, box_to_rhino, frame_to_rhino

#print assembly
print(my_assembly)
#counter = int(counter)

#get parts datastructure
parts = [p for p in my_assembly.parts()]

#get current part

#if show_wall == True:

if show == "show_all":
    
#get parts datastructure
    parts = [p for p in my_assembly.parts()]
    parts_geometry = []
    parts_frame = []

    #part = parts[0]
    #print(part.gripping_frame)

    #extract the mesh of the parts for visulization (+ converted to rhino mesh)
    parts_geometry = [mesh_to_rhino(p.mesh) for p in parts]
    
    #extract the frame of the parts for visulization (+ converted to rhino plane)
    parts_frame = [frame_to_rhino(p.frame) for p in parts]
    #print(parts_geometry)

    key = my_assembly.graph.number_of_nodes()-1

if show == "show_until_key":
    #extract the mesh of the parts for visulization (+ converted to rhino mesh)
    parts_geometry = [mesh_to_rhino(p.mesh) for p in parts[0:int(counter)]]
    
    #extract the frame of the parts for visulization (+ converted to rhino plane)
    parts_frame = [frame_to_rhino(p.frame) for p in parts[0:int(counter)]]

    key = int(counter)-1

if show == "show_nothing":
    print("Nothing to see")
    pass

if highlight_current_part:
    current_part = my_assembly.part(key)
    current_part_geometry = mesh_to_rhino(current_part.mesh)
    current_part_frame = frame_to_rhino(current_part.frame)
    current_part_gripping_frame = frame_to_rhino(current_part.gripping_frame)
    
    print(current_part.__data__)
# ---------- end visualize_2 ----------
panel_5 = Panel(visualize_2.out)
geo_3 = Geometry(visualize_2.parts_geometry)
geo_4 = Geometry([visualize_2.current_part_frame, visualize_2.current_part_geometry])
geo_5 = Geometry(visualize_2.current_part_gripping_frame)
geo_6 = Geometry(visualize_2.parts_frame)
preview = CustomPreview(Geometry=geo_3, Material=ColourSwatch(SwatchColor=RGB(196, 141, 141)))
preview_2 = CustomPreview(Geometry=geo_6, Material=ColourSwatch(SwatchColor=RGB(255, 125, 157)))
preview_3 = CustomPreview(Geometry=geo_4, Material=ColourSwatch(SwatchColor=RGB(255, 125, 157)))
preview_4 = CustomPreview(Geometry=geo_5, Material=ColourSwatch(SwatchColor=RGB(255, 125, 157)))
draw_2 = Python3Script(planes=geo_5, scale=Slider(0.2, range=0..1))  # -> out, P, V, C, W; inputs planes: list of Plane
# ---------- draw_2: Python ----------
from System.Drawing import Color

red = Color.FromArgb(255, 0, 0)
green = Color.FromArgb(0, 255, 0)
blue = Color.FromArgb(0, 0, 255)

P = []
V = []
C = []

scale = float(scale)

for plane in planes:
    if not plane:
        continue
    P += [plane.Origin] * 3
    V.append(plane.XAxis * scale)
    V.append(plane.YAxis * scale)
    V.append(plane.ZAxis * scale)
    C += [red, green, blue]

W = 3
# ---------- end draw_2 ----------
vdisex = VectorDisplayEx(Point=draw_2.P, Vector=draw_2.V, Colour=draw_2.C, Width=draw_2.W)

# ----
# Radiation Simulation
toggle_3 = BooleanToggle(False)
radiation_simulation = RadiationSimulation(
    sky_mtx=shading_simulation.sky_mtx,
    geometry=visualize_2.parts_geometry,
    context=context_input,
    offset_dist=number_slider_4,
    run=toggle_3)  # -> mesh, legend
geo_7 = Geometry(radiation_simulation.legend)
brick_wall = Mesh(radiation_simulation.mesh)

# ----
# Export to JSON
path = Python3Script()  # -> HERE, DATA, ASSEMBLY
# ---------- path: Python ----------
import os

HERE = os.path.dirname(ghdoc.Path)
DATA = os.path.abspath(os.path.join(HERE, "..", "data"))
ASSEMBLY = os.path.abspath(os.path.join(DATA, "assembly"))

print(HERE)
print(DATA)
print(ASSEMBLY)
# ---------- end path ----------
export = Button()
export_2 = Python3Script(ASSEMBLY=path.ASSEMBLY, my_assembly=transform.my_assembly, export=export)  # -> out; inputs ASSEMBLY: String
# ---------- export_2: Python ----------
import os

#print(my_assembly.__data__)
if export:
    #print(DATA)
    filename = "brickwall_2x2_full_and_insulated.json"
    PATH = os.path.join(ASSEMBLY, filename)

    # the assembly has to be serialized such that it can be called from CPython
    my_assembly.to_json(PATH)
# ---------- end export_2 ----------

number_slider_6 = Slider(3, range=0.4..10)  # disabled
number_slider_7 = Slider(1.2, range=0.3..10)  # disabled
py3_3 = Python3Script(wall_length=number_slider_6, wall_height=number_slider_7)  # -> out, M; inputs wall_length: Double, wall_height: Double; disabled
# ---------- py3_3: Python ----------
from compas.datastructures import Mesh
from compas.geometry import Curve, Point, Frame
from compas_rhino.conversions import frame_to_rhino, mesh_to_rhino
import math as m
import Rhino.Geometry as rg


mesh_wall = Mesh()

mesh_grid = []

length, width, height, mortar = 0.245, 0.12, 0.075, 0.11

step_in_z = height + mortar/2
step_in_x = (length+width)/2 + mortar
vertices_per_row = int(wall_length / step_in_x)
row = int(wall_height / step_in_z)


total_length = (vertices_per_row - 1) * (step_in_x)


#create vertices
for j in range(row): 
    z = j * step_in_z
    for i in range(vertices_per_row): 
        y = 0
        x = i * step_in_x
        mesh_wall.add_vertex(x = x, y = y, z = z) 

#create faces
for j in range(row -1):
    planes_per_row = []
    for i in range(vertices_per_row - 1):
        a = i + j * vertices_per_row
        b = a + vertices_per_row
        c = b + 1
        d = a + 1

#create planes at faces_centroid
        vertex_centroid = mesh_wall.face_centroid(mesh_wall.add_face([a, b, c, d]))
        vertex_pts = Point(vertex_centroid[0], vertex_centroid[1], vertex_centroid[2])
        vertex_frame = Frame([vertex_pts[0], vertex_pts[1], vertex_pts[2]], [1,0,0], [0,1,0])
        vertex_plane = frame_to_rhino(vertex_frame)
        planes_per_row.append(vertex_plane)
    mesh_grid.append(planes_per_row)

face_cplanes = [plane for planes_row in mesh_grid for plane in planes_row]

M = mesh_to_rhino(mesh_wall)
# ---------- end py3_3 ----------

# ==== cluster ShadingSimulation
epw_file = ClusterInput()
start_month = ClusterInput()
start_day = ClusterInput()
start_hour = ClusterInput()
end_month = ClusterInput()
end_day = ClusterInput()
end_hour = ClusterInput()
importepw = LBImportEPW(epw_file=epw_file)  # -> location, dry_bulb_temperature, dew_point_temperature, relative_humidity, wind_speed, wind_direction, direct_normal_rad, diffuse_horizontal_rad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; plug-in component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
analysisperiod = LBAnalysisPeriod(
    start_month=start_month,
    start_day=start_day,
    start_hour=start_hour,
    end_month=end_month,
    end_day=end_day,
    end_hour=end_hour)  # -> period, hoys, dates; plug-in component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
north = ClusterInput()
hoys = ClusterOutput(analysisperiod.hoys)
skymatrix = LBCumulativeSkyMatrix(
    north=north,
    location=importepw.location,
    direct_rad=importepw.direct_normal_rad,
    diffuse_rad=importepw.diffuse_horizontal_rad,
    hoys=analysisperiod.hoys)  # -> report, sky_mtx; plug-in component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
location = ClusterOutput(importepw.location)
sky_mtx = ClusterOutput(skymatrix.sky_mtx)
colrange = LBColorRange(index=Slider(5, range=0..100))  # -> colors; plug-in component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
geometry = ClusterInput()
context = ClusterInput()
grid_size = ClusterInput()
offset_dist = ClusterInput()
run = ClusterInput()
legendpar = LBLegendParameters(colors=colrange)  # -> leg_par; plug-in component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
incidentradiation = LBIncidentRadiation(
    sky_mtx=skymatrix.sky_mtx,
    geometry=flatten(geometry),
    context=flatten(context),
    grid_size=grid_size,
    offset_dist=offset_dist,
    legend_par=legendpar,
    run=run)  # -> report, points, results, total, mesh, legend, title, int_mtx; plug-in component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
results = ClusterOutput(incidentradiation.results)
mesh = ClusterOutput(incidentradiation.mesh)
legend = ClusterOutput(incidentradiation.legend)

# ==== cluster RadiationSimulation
colrange = LBColorRange(index=Slider(0, range=0..100))  # -> colors; plug-in component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
sky_mtx = ClusterInput()
geometry = ClusterInput()
context = ClusterInput()
offset_dist = ClusterInput()
run = ClusterInput()
legendpar = LBLegendParameters(colors=colrange)  # -> leg_par; plug-in component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
incidentradiation = LBIncidentRadiation(
    sky_mtx=sky_mtx,
    geometry=flatten(geometry),
    context=flatten(context),
    grid_size=Slider(1, range=0..1),
    offset_dist=offset_dist,
    legend_par=legendpar,
    run=run)  # -> report, points, results, total, mesh, legend, title, int_mtx; plug-in component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
legend = ClusterOutput(incidentradiation.legend)
mesh = ClusterOutput(incidentradiation.mesh)
